# Dynamo custom node RPW_GetFilepath.dyf (Dynamo 1.2.1.3083)
# category: Python

python_script = Python()  # unwired: IN[0]
# ---------- python_script.python (23 lines) ----------
""" 
RevitPythonWrapper
==================
Gui Talarico
https://github.com/gtalarico/revitpythonwrapper
http://revitpythonwrapper.readthedocs.io/en/latest/index.html
"""

import clr
import sys
sys.path.append(r'C:\Program Files (x86)\IronPython 2.7\Lib')
import os

appdata_path = os.getenv('appdata')
dynamo_path = os.path.join(appdata_path, 'Dynamo')

module_path = None
for root, subfolders, files in os.walk(dynamo_path):
	if 'RevitPythonWrapper' in subfolders:
		extra_path = os.path.join(root, 'RevitPythonWrapper', 'extra')
		module_path = os.path.join(extra_path, 'rpw.zip')

OUT = module_path  or 'Could Not Find Module. Make sure it\'s installed properly'
# ----------------------------------------
Output = Output(python_script)  # ""
