# Dynamo graph dynamo_tests.DYN (Dynamo 1.2.0.2690)

# group: Python Tests
file_path = Filename(".\rpw_dynamo_tests.py")
readText = File.ReadText(file_path)
python_script_from_string = PythonStringNode(script=readText)
watch = Watch(python_script_from_string)
